% Simulink data dictionary Properties.sldd

Wheel_inertia = Simulink.Parameter(0.0205, DataType="double", Unit="kg*m^2")
Engine_inertia = Simulink.Parameter(0.0896, DataType="double", Unit="kg*m^2")
Loaded_radius = Simulink.Parameter(0.2, DataType="double", Unit="m")
Effective_radius = Simulink.Parameter(0.2, DataType="double", Unit="m")
Transmission_ratios = Simulink.Parameter([0 0; 1 2.583; 2 2; 3 1.667; 4 1.444; 5 1.286; 6 1.15], DataType="double", Unit="1")
Brake_radius = Simulink.Parameter(0.1, DataType="double", Unit="m")
ARB_torsional_rigidity = Simulink.Parameter(1, DataType="double", Unit="N*m^2")
ARB_arm = Simulink.Parameter([0.1 0.1], DataType="double", Unit="m")
Ackermann_percentage = Simulink.Parameter(70, DataType="double", Unit="%")
Initial_speed = Simulink.Parameter(15, DataType="double", Unit="m/s")
Rear_axles_omega = Simulink.Parameter(46, DataType="double", Unit="rad/s")
Initial_omega = Simulink.Parameter(75, DataType="double", Unit="rad/s")
Brake_bias = Simulink.Parameter(0.5, DataType="double", Unit="one")
Spin_min_threshold = Simulink.Parameter(0.05, DataType="double", Unit="rad")
Car_mass = Simulink.Parameter(245, DataType="double", Unit="kg")
CG_z = Simulink.Parameter(0.3, DataType="double", Unit="m")
CG_x = Simulink.Parameter(0.6, DataType="double", Unit="m")
Wheelbase = Simulink.Parameter(1.2, DataType="double", Unit="m")
Car_Iz = Simulink.Parameter(145, DataType="double", Unit="kg*m^2")
Track_width = Simulink.Parameter([2 2], DataType="double", Unit="m")
Shock_stiffness = Simulink.Parameter([10000 10000], DataType="double", Unit="N/m")
Shock_damping = Simulink.Parameter([10000 10000], DataType="double", Unit="N*s/m")